# Grasshopper definition random-walk-script.gh (Grasshopper 1.0.8)

# ---- group: random walk using numpy
mean = Slider(0, range=-1..1)
deviation = Slider(0.5, range=0..1)
seed = Slider(0, range=0..100)
# random walk
# using python
iterations = Slider(5000, range=0..10000)
random_walk = Python3Script(i=iterations, mu=mean, sigma=deviation, seed=seed)  # -> x, y; inputs i: Int32, mu: Double, sigma: Double, seed: Int32
# ---------- random_walk: Python ----------
"""Random Walk"""

__author__ = "Brendan Harmon"
__copyright__ = "Copyright 2025, Brendan Harmon"
__email__ = "brendan.harmon@gmail.com"
__license__ = "MIT"
__version__ = "1.0.0"

# requirements: numpy

# Import libraries
import numpy as np

# Instantiate random number generator
if seed is not None:
    rng = np.random.default_rng(seed)
else:
    rng = np.random.default_rng()

# Generate random steps
u = rng.normal(mu, sigma, i)
v = rng.normal(mu, sigma, i)

# Solve position
x = np.cumsum(u).tolist()
y = np.cumsum(v).tolist()
# ---------- end random_walk ----------
construct_point = ConstructPoint(XCoordinate=random_walk.x, YCoordinate=random_walk.y, ZCoordinate=0)
point = Point(construct_point)
