# Grasshopper definition random-walk.gh (Grasshopper 1.0.8)

# ---- group: x-component
# random walk
# x-component of steps
panel = Panel("-1 To 1")
iterations = Slider(1000, range=0..10000)
seed = Slider(1, range=0..1000)
random = Random(Range=panel, Number=iterations, Seed=seed, Integers=False)
mass_addition = MassAddition(Input=random)  # -> Result, PartialResults
X = Number(mass_addition.PartialResults)

# ---- group: y-component
# y-component of steps
# seed + 1
domain = Domain(panel)
iterations_2 = Number(iterations)
seed_2 = Number(expr("x+1", seed))
random_2 = Random(Range=domain, Number=iterations_2, Seed=seed_2, Integers=False)
mass_addition_2 = MassAddition(Input=random_2)  # -> Result, PartialResults
Y = Number(mass_addition_2.PartialResults)

# ---- group: plot
# plot random walk
X_2 = Number(X)
Y_2 = Number(Y)
construct_point = ConstructPoint(XCoordinate=X_2, YCoordinate=Y_2, ZCoordinate=0)
dot_display = DotDisplay(Point=construct_point, Colour=RGB(0, 0, 0), Size="0.5")
